# Grasshopper definition test.gh (Grasshopper 1.0.8)

panel = Panel("https://climate.onebuilding.org/WMO_Region_6_Europe/ESP_Spain/CT_Catalonia/ESP_CT_Barcelona-El.Prat.AP.081810_TMYx.zip")
panel_2 = Panel("S4")
py3 = Python3Script(folder="C:\Users\Utente\Desktop\ladybug\ladybug_test\dati", scenario="S0", every="20")  # -> out, context, pts, info
# ---------- py3: Python ----------
import csv, json, os
import Rhino.Geometry as rg

def crown(r):
    h, hb = float(r["height_m"]), float(r["crown_base_m"])
    d, z0 = float(r["crown_diam_m"]), float(r["ground_z"])
    c = rg.Point3d(float(r["x"]), float(r["y"]), z0 + (h + hb) / 2.0)
    s = rg.Sphere(rg.Point3d.Origin, 1.0).ToBrep()
    s.Transform(rg.Transform.Scale(rg.Plane.WorldXY, d / 2.0, d / 2.0, max(h - hb, 1.0) / 2.0))
    s.Transform(rg.Transform.Translation(rg.Vector3d(c)))
    return s

f = lambda name: os.path.join(folder, name)
every = int(every) if every else 1

# buildings
buildings = []
gj = json.load(open(f("street_andreu-nin_buildings_20261031.geojson"), encoding="utf-8"))
for ft in gj["features"]:
    g, p = ft["geometry"], ft["properties"]
    polys = [g["coordinates"]] if g["type"] == "Polygon" else g["coordinates"]
    for poly in polys:
        z0 = p["ground_z"]
        crv = rg.PolylineCurve([rg.Point3d(q[0], q[1], z0) for q in poly[0]])
        if crv.ClosedCurveOrientation(rg.Vector3d.ZAxis) == rg.CurveOrientation.Clockwise:
            crv.Reverse()                      # so the extrusion goes up
        ext = rg.Extrusion.Create(crv, p["height_m"], True)
        if ext:
            buildings.append(ext.ToBrep())

# trees around the street (the same in both runs)
others = [crown(r) for r in csv.DictReader(open(f("street_andreu-nin_context_trees_20261031.csv"), encoding="utf-8"))
          if r["flag"] == "ok" and r["crown_base_m"]]

# street trees: S0 = today, S4 = tool layout
name = "street_andreu-nin_trees_S0_current_20261031.csv" if scenario == "S0" else \
       "street_andreu-nin_trees_S4_s1.00_w0.00_r0.00_20261031.csv"
street = [crown(r) for r in csv.DictReader(open(f(name), encoding="utf-8"))]

# test points (every = 1 all points; 20 = one in twenty, for a quick test)
rows = list(csv.DictReader(open(f("street_andreu-nin_testpoints_20261031.csv"), encoding="utf-8")))
pts = [rg.Point3d(float(r["x"]), float(r["y"]), float(r["z"])) for r in rows[::every]]

context = buildings + others + street
info = "scenario {}: {} buildings, {} context crowns, {} street crowns, {} points".format(
    scenario, len(buildings), len(others), len(street), len(pts))
# ---------- end py3 ----------
downloadepw = LBDownloadWeather(weather_URL=panel)  # -> epw_file, stat_file, ddy_file; plug-in component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
panel_3 = Panel(py3.info)
importepw = LBImportEPW(epw_file=downloadepw.epw_file)  # -> location, dry_bulb_temperature, dew_point_temperature, relative_humidity, wind_speed, wind_direction, direct_normal_rad, diffuse_horizontal_rad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; plug-in component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
analysisperiod = LBAnalysisPeriod(start_month="7", start_day="15", start_hour="11", end_month="7", end_day="15", end_hour="16")  # -> period, hoys, dates; plug-in component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
applyper = LBApplyAnalysisPeriod(data=importepw.relative_humidity, period=analysisperiod.period)  # -> data; plug-in component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
applyper_2 = LBApplyAnalysisPeriod(data=importepw.wind_speed, period=analysisperiod.period)  # -> data; plug-in component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
applyper_3 = LBApplyAnalysisPeriod(data=importepw.direct_normal_rad, period=analysisperiod.period)  # -> data; plug-in component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
applyper_4 = LBApplyAnalysisPeriod(data=importepw.diffuse_horizontal_rad, period=analysisperiod.period)  # -> data; plug-in component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
applyper_5 = LBApplyAnalysisPeriod(data=importepw.horizontal_infrared_rad, period=analysisperiod.period)  # -> data; plug-in component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
applyper_6 = LBApplyAnalysisPeriod(data=importepw.dry_bulb_temperature, period=analysisperiod.period)  # -> data; plug-in component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
dry_bulb_t = Data(applyper_6)
panel_4 = Panel(dry_bulb_t)
relativ_humidity = Data(applyper)
panel_5 = Panel(relativ_humidity)
wind_speed = Data(applyper_2)
panel_6 = Panel(wind_speed)
direct_normal_rad = Data(applyper_3)
panel_7 = Panel(direct_normal_rad)
diffuse_horizontal_rad = Data(applyper_4)
panel_8 = Panel(diffuse_horizontal_rad)
horizontal_infrared_rad = Data(applyper_5)
panel_9 = Panel(horizontal_infrared_rad)
humantosky = LBHumanToSkyRelation(location=importepw.location, position=flatten(py3.pts), context=flatten(py3.context), run=Toggle(True))  # -> report, human_points, human_line, fract_body_exp, sky_exposure; plug-in component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
utci = LBUTCIComfort()  # -> report, utci, comfort, condition, category, comf_obj; plug-in component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
outdoorsolarmrt = LBOutdoorSolarMRT(
    location=importepw.location,
    surface_temp=dry_bulb_t,
    dir_norm_rad=direct_normal_rad,
    diff_horiz_rad=diffuse_horizontal_rad,
    horiz_infrared=horizontal_infrared_rad,
    fract_body_exp=humantosky.fract_body_exp,
    sky_exposure=humantosky.sky_exposure,
    ground_ref="0.25",
    run=Toggle(True))  # -> report, short_erf, long_erf, short_dmrt, long_dmrt, mrt; plug-in component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
